# Grasshopper definition Spikey_cone_git.gh (Grasshopper 1.0.7)
# plug-ins: Hops

hops = Hops(
    Radius=Slider(10, range=0..10),
    Count=Slider(520, range=0..1000),
    Length=Slider(10, range=0..10),
    CacheResultsInMemory=True,
    CacheSolveResults=True,
    RemoteDefinitionLocation="C:\Users\atva\OneDrive - Liljewall Arkitekter AB\Dokument\IAAC_MACAD\06b_MODUL 2\S3 Digital tools for Cloud-based Data Management\Delivery\Session 01\Athan\Spikey_cone.gh",
    RemoteSolveVersion=(0, 1, 0),
    ShowInput_Enabled=False,
    ShowInput_Path=False,
    SynchronousSolve=True)
panel = Panel("\"C:\\Users\\atva\\OneDrive - Liljewall Arkitekter AB\\Dokument\\IAAC_MACAD\\06b_MODUL 2\\S3 Digital tools for Cloud-based Data Management\\Delivery\\Session 01\\Athan\\Spikey_cone.gh\"")
hops_2 = Hops(
    _Path=panel,
    CacheResultsInMemory=True,
    CacheSolveResults=True,
    RemoteDefinitionLocation="\"C:\\Users\\atva\\OneDrive - Liljewall Arkitekter AB\\Dokument\\IAAC_MACAD\\06b_MODUL 2\\S3 Digital tools for Cloud-based Data Management\\Delivery\\Session 01\\Athan\\Spikey_cone.gh\"",
    RemoteSolveVersion=(0, 1, 0),
    ShowInput_Enabled=False,
    ShowInput_Path=True,
    SynchronousSolve=True)
